# Grasshopper definition bbD2.gh (Grasshopper 1.0.8)
# plug-ins: LunchBox

panel = Panel("{\"version\":10000,\"archive3dm\":80,\"opennurbs\":-1872981175,\"data\":\"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\"}")
panel_2 = Panel("{\"version\":10000,\"archive3dm\":80,\"opennurbs\":-1872981175,\"data\":\"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\"}")
b2 = GetString(panel, AtLeast=1, AtMost=1, TreeAccess=False)
b1 = GetString(panel_2, AtLeast=1, AtMost=1, TreeAccess=False)
deserialize = DeserializeGeometry(SerializedText=b1, Encryption="JSON")
deserialize_2 = DeserializeGeometry(SerializedText=b2, Encryption="JSON")
sdiff = SolidDifference(BrepsA=deserialize, BrepsB=deserialize_2)
edges = BrepEdges(Brep=sdiff)  # -> Naked, Interior, NonManifold

# ---- group: RH_OUT:Def
geo = Geometry(sdiff)

# ---- group: RH_OUT:Edge
geo_2 = Geometry(edges.Interior)
